% Simulink data dictionary Based_FOC_Data.sldd

Pq = 3.8947
Sig = Simulink.Signal()
Period = Simulink.Parameter(8500, StorageClass="Define")  % SVPWM周期，中心堆成模式，定时器周期乘以二
Ts = Simulink.Parameter(5.0e-5, StorageClass="Define", DataType="single")  % PWM周期
Udc = Simulink.Parameter(300, StorageClass="Define", DataType="double")
Pn = Simulink.Parameter(4, StorageClass="Define")
flux = Simulink.Parameter(0.08627, StorageClass="Define", DataType="single")
Rs = Simulink.Parameter(0.62, StorageClass="Define", DataType="single")
L = Simulink.Parameter(0.002075, StorageClass="Define", DataType="single")
PLL_P = Simulink.Parameter(1000, StorageClass="Define")
PLL_I = Simulink.Parameter(5000, StorageClass="Define")
sin_theta = Simulink.Signal(StorageClass="ExportedGlobal", DataType="single")
cos_theta = Simulink.Signal(StorageClass="ExportedGlobal", DataType="single")
gamma = Simulink.Parameter(100000, StorageClass="Define", DataType="single")